# Grasshopper definition git_robot.gh (Grasshopper 1.0.7)
# plug-ins: Triceratops, Githopper

panel = Panel("git pull origin ")  # disabled

# ---- group: Github Integration
username = Panel("l00sed")
email = Panel("danielwtompkins@gmail.com")
# # README
# 
# 1. Before getting started, create an account at [food4rhino.com](https://food4rhino.com) and download the latest version of [GitHopper](https://www.food4rhino.com/app/githopper).
# 
# 2. Move the grasshopper python script to `C:/Users/USERNAME/AppData/Roaming/Grasshopper/Libraries`
# 
# 3. You may need to right-click on the file, select properties, and check the "Unblock" toggle.
# 
# ## Getting Started
# 
# 1. Add a new panel with your 'Username' and 'Email' to link to your GitHub account.
# 
# 2. Double-click the boolean toggle ("Initialize") to allow GitHopper to recognize the existence of the repo.
# 
# 	- The "Status" panel should now read: `The git repository initialized successfully`
# 
# 3. Drag the number slider to choose from the available branches.
# 
# 4. You can click the 'git pull' button to download the latest files / grasshopper script to your local machine. However, I recommend using an actual terminal to pull before opening Rhino at all.
# 
# ## Pushing to Remote
# 
# 1. After making changes, *SAVE* your grasshopper file.
# 
# 2. Click the 'git add' button to add your updated files
# 
# 3. Click the 'git commit' button to commit your changes with the optional "Commit Message" text (you can change this in the panel, default is "updated").
# 
# 4. Click the 'git push' button to push to the remote repo. You should receive a pop-up to put in your GitHub credentials. If the pop-up closes without any additional dialog, you might want to try again (you probably didn't enter your password correctly).
initialize = BooleanToggle(True)
git_add = Button()
git_commit = Button()
git_push = Button()
git_pull = Button()  # disabled
select_branch = SelectBranch(Index=Slider(1, range=0..3))  # -> Branch, Branches
nickname = RelativePath()
commit_message = Panel("updated")
branch = Panel(select_branch.Branch)
create_git = CreateGitRepository(User_name=username, User_email=email, Initialize=initialize)  # -> Report, Help
path = GitPath(Path=nickname, Create_path=initialize, Set=initialize)  # -> Report, Help
concat = Concatenate(FragmentA=commit_message, FragmentB="\" & exit")
concat_2 = Concatenate(FragmentA=branch, FragmentB=" & exit")
concat_3 = Concatenate(FragmentA="git commit -m \"", FragmentB=concat)
concat_4 = Concatenate(FragmentA="git push origin ", FragmentB=concat_2)
panel_2 = Panel(path.Report)
status = Panel(create_git.Report)
execute = ExecuteGitCommand(Command="git add -A & exit", Execute=git_add)
execute_2 = ExecuteGitCommand(Command=concat_3, Execute=git_commit)
execute_3 = ExecuteGitCommand(Command=concat_4, Execute=git_push)

# ----
concat_5 = Concatenate(FragmentA=panel, FragmentB=concat_2)  # disabled
execute_4 = ExecuteGitCommand(Command=concat_5, Execute=git_pull)  # disabled
