# Grasshopper definition palette_git_master.gh (Grasshopper 0.9.76)
# plug-ins: Python Interpreter, EleFront, Pancake, Palette

# ---- group: Palette
swatch = ColourSwatch(SwatchColor=RGBA(0, 255, 255, 0))
swatch_2 = ColourSwatch(SwatchColor=RGB(64, 70, 67))
swatch_3 = ColourSwatch(SwatchColor=RGBA(0, 0, 0, 28))
swatch_4 = ColourSwatch(SwatchColor=RGB(68, 255, 156))
swatch_5 = ColourSwatch(SwatchColor=RGB(255, 187, 156))
swatch_6 = ColourSwatch(SwatchColor=RGB(241, 111, 90))
swatch_7 = ColourSwatch(SwatchColor=RGBA(255, 0, 72, 179))
swatch_8 = ColourSwatch(SwatchColor=RGB(255, 0, 72))
swatch_9 = ColourSwatch(SwatchColor=RGB(40, 50, 50))
swatch_10 = ColourSwatch(SwatchColor=RGB(255, 255, 255))
swatch_11 = ColourSwatch(SwatchColor=RGB(255, 55, 72))
number_slider = Slider(15, range=0..100)
swatch_12 = ColourSwatch(SwatchColor=RGBA(255, 255, 255, 160))
palette = Palette(
    ModeCustomStandard=Toggle(True),
    Component_Normal_Deselected_Fill_Color=swatch_2,
    Component_Normal_Deselected_Edge_Color=swatch_3,
    Component_Normal_Deselected_Text_Color=swatch_12,
    Component_Normal_Selected_Fill_Color=swatch_4,
    Component_Normal_Selected_Edge_Color=swatch_3,
    Component_Normal_Selected_Text_Color=ColourSwatch(SwatchColor=RGB(0, 0, 0)),
    Component_Hidden_Deselected_Fill_Color=swatch_3,
    Component_Hidden_Deselected_Edge_Color=swatch_3,
    Component_Hidden_Deselected_Text_Color=swatch_12,
    Component_Hidden_Selected_Fill_Color=ColourSwatch(SwatchColor=RGBA(68, 255, 156, 137)),
    Component_Hidden_Selected_Edge_Color=swatch_3,
    Component_Hidden_Selected_Text_Color=ColourSwatch(SwatchColor=RGBA(0, 0, 0, 203)),
    Component_Disabled_Deselected_Fill_Color=swatch,
    Component_Disabled_Deselected_Edge_Color=swatch,
    Component_Disabled_Deselected_Text_Color=swatch_2,
    Component_Disabled_Selected_Fill_Color=RGB(110, 150, 115),
    Component_Disabled_Selected_Edge_Color=RGB(40, 70, 40),
    Component_Disabled_Selected_Text_Color=RGB(75, 100, 65),
    Component_Warning_Deselected_Fill_Color=swatch_5,
    Component_Warning_Deselected_Edge_Color=swatch_5,
    Component_Warning_Deselected_Text_Color=RGB(0, 0, 0),
    Component_Warning_Selected_Fill_Color=swatch_6,
    Component_Warning_Selected_Edge_Color=swatch_6,
    Component_Warning_Selected_Text_Color=RGB(0, 0, 0),
    Component_Error_Deselected_Fill_Color=swatch_7,
    Component_Error_Deselected_Edge_Color=swatch_7,
    Component_Error_Deselected_Text_Color=swatch_9,
    Component_Error_Selected_Fill_Color=swatch_8,
    Component_Error_Selected_Edge_Color=swatch_8,
    Component_Error_Selected_Text_Color=swatch_9,
    Component_Label_Deselected_Fill_Color=swatch_9,
    Component_Label_Deselected_Edge_Color=swatch_9,
    Component_Label_Deselected_Text_Color=swatch_10,
    Component_Label_Selected_Fill_Color=swatch_9,
    Component_Label_Selected_Edge_Color=swatch_9,
    Component_Label_Selected_Text_Color=swatch_10,
    Galapagos_Deselected_Fill_Color=swatch_11,
    Galapagos_Deselected_Edge_Color=swatch_3,
    Galapagos_Selected_Fill_Color=swatch_4,
    Galapagos_Selected_Edge_Color=swatch_3,
    Wire_Normal_Color=swatch_12,
    Wire_Empty_Color=swatch_3,
    Wire_Selected_Start_Color=swatch_4,
    Wire_Selected_End_Color=ColourSwatch(SwatchColor=RGB(0, 255, 255)),
    Panel_Default_Color=swatch_10,
    Group_Default_Color=swatch_11,
    Canvas_Background_Color=swatch_9,
    Canvas_Gridline_Color=ColourSwatch(SwatchColor=RGB(50, 60, 60)),
    Canvas_Gridline_Width=number_slider,
    Canvas_Gridline_Height=number_slider,
    Canvas_Edge_Color=swatch_11,
    Canvas_Shadow_Color=swatch_11,
    Canvas_Shadow_Size=Slider(100, range=0..100),
    MonochromaticOnOff=False,
    Monochromatic_Color=RGB(212, 208, 200))

# ---- group: Git
panel = Panel("C:\Users\dwt46\Documents\grasshopper")
git_status = PythonScript(Bool=Toggle(True), Dir=panel)  # -> out, a
# ---------- git_status: Python ----------
import subprocess
if Bool == True:
    print subprocess.check_output(['wsl', 'git', 'status'], cwd=Dir)
# ---------- end git_status ----------
git_add = PythonScript(Button=Button(), Dir=panel)  # -> out, a
# ---------- git_add: Python ----------
import subprocess
if Button == True:
    print subprocess.check_output(['wsl', 'git', 'add', '-A'], cwd=Dir)
# ---------- end git_add ----------
git_commit = PythonScript(Button=Button(), Dir=panel)  # -> out, a
# ---------- git_commit: Python ----------
import subprocess
if Button == True:
    print subprocess.check_output(['wsl', 'git', 'commit', '-m', 'updated'], cwd=Dir)
# ---------- end git_commit ----------
git_push = PythonScript(Button=Button(), Dir=panel)  # -> out, a
# ---------- git_push: Python ----------
import subprocess
if Button == True:
    print subprocess.check_output(['wsl', 'git', 'push', 'origin', 'rhino5'], cwd=Dir)
# ---------- end git_push ----------
panel_2 = Panel(git_status.out)

# ----
toggle = BooleanToggle(True)
sph = Sphere(Base=PlaneXY(0, 0, 0), Radius=5)
mesh = MeshBrep(
    Brep=sph,
    Settings={GridMaxCount=0, GridMinCount=16, JaggedSeams=False, MaxEdgeLength=0, MinEdgeLength=0.0001, MinTolerance=0, Refine=True, RefineAngle=0, RelativeTolerance=0.65, SimplePlanes=True, Tolerance=0})
ip = PythonScript(Bool=toggle)  # -> out, a
# ---------- ip: Python ----------
import subprocess
if Bool == True:
    print subprocess.call(['wsl', 'ifdata', '-pa', 'eth0'])
# ---------- end ip ----------
demesh = DeconstructMesh(Mesh=mesh)  # -> Vertices, Faces, Colours, Normals
item = ListItem(List=ip.out, Index=0, Wrap=True)  # -> flatten(Item)
lng = ListLength(List=demesh.Faces)
deface = DeconstructFace(Face=demesh.Faces)  # -> CornerA, CornerB, CornerC, CornerD
panel_3 = Panel(item)
httpin = HttpInput(Start=Toggle(True), Prefix="http://localhost:8080/grasshopper/")  # -> Keys, Values, ListenerObject
series = Series(Start=0, Step=1, Count=lng)
item_2 = ListItem(List=series, Index=expr("x-1", lng), Wrap=True)
serve = PythonScript(Bool=toggle, Dir="C:\Users\dwt46\Documents\grasshopper\threejs", ip=panel_3)  # -> out, a
# ---------- serve: Python ----------
from subprocess import Popen, PIPE
if Bool == True:
    p = Popen(['wsl', 'browser-sync', 'start', '-s', '-f', '.', '--no-notify', '--host', ip, '--port', '9000'], cwd=Dir, stdin=PIPE, stdout=PIPE, stderr=PIPE)
    print repr(p.communicate("stdout"))
# ---------- end serve ----------
gradient = Gradient(LowerLimit=0, UpperLimit=item_2, Parameter=deface.CornerD, stops=[0.267: RGB(255, 255, 0), 0.979: RGB(220, 0, 40)])
item_3 = ListItem(List=serve.out, Index=1, Wrap=True)
httpout = HttpOutput(HttpListener=httpin.ListenerObject)
mcol = MeshColours(Mesh=mesh, Colours=gradient)
pcecfbx = FBXExportOption(NURBSExport=True, MaterialAsPhong=True, MapZToY=True)
# Line
# LineBasicMaterial
# LineDashedMaterial
# LineBasicMaterial
# LineDashedMaterial
# Scene Example
# Annotations
pcec3dm = RhinoFileExportOption(Version=5, DropPreviewMesh=False, SaveGeometryOnly=False, SaveTexture=True, SaveNotes=True, SavePluginData=True)
panel_4 = Panel(item_3)
rhatt = GetRhinoAttributes(Geometry=mcol)  # -> Name, Layer, Color
pcexportas = ExportAs(
    Geometry=mcol,
    ObjectAttributes=rhatt.Color,
    FileLocation="C:\Users\dwt46\Documents\grasshopper\threejs\test.fbx",
    Overwrite=True,
    Options=pcecfbx,
    PreOptions=pcec3dm,
    Export=Toggle(True),
    CompMode=False)  # -> OK, ExportCommand
panel_5 = Panel(pcexportas.OK)
